# Grasshopper definition grashopper.gh (Grasshopper 0.9.76)

# ---- group: pieza / Coordenadas rectangulo
number_slider = Slider(0.1, range=0.1..5)
neg = Negative(Value=number_slider)
dom = ConstructDomain(DomainStart=neg, DomainEnd=number_slider)
dom_2 = ConstructDomain(DomainStart="0", DomainEnd=Slider(1.4, range=0..5))

# ---- group: pieza
number_slider_2 = Slider(3, range=3..10)
polygon = Polygon(Plane=PlaneXY(0, 0, 0), Radius=Slider(5, range=0..10), Segments=number_slider_2, FilletRadius=0)  # -> Polygon, Length
explode = Explode(Curve=polygon.Polygon, Recursive=True)  # -> Segments, Vertices
eval = EvaluateLength(Curve=explode.Segments, Length=Slider(0.5, range=0..1), Normalized=True)  # -> Point, Tangent, Parameter
xy = XYPlane(Origin=eval.Point)
align = AlignPlane(Plane=xy, Direction=eval.Tangent)  # -> Plane, Angle
rectangle = Rectangle(Plane=align.Plane, XSize=dom, YSize=dom_2, Radius=0)  # -> Rectangle, Length
boundary = BoundarySurfaces(Edges=polygon.Polygon)
rdiff = RegionDifference(CurvesA=boundary, CurvesB=rectangle.Rectangle)
multiplication = Multiplication(A=number_slider, B="2")
boundary_2 = BoundarySurfaces(Edges=rdiff)
Z = UnitZ(Factor=multiplication)
extr = Extrude(Base=boundary_2, Direction=Z)

# ----
debrep = DeconstructBrep(Brep=extr)  # -> Faces, Edges, Vertices
addition = Addition(A="0", B=Slider(0.05, range=0.05..1))
crv = Curve(<curve referenced from the Rhino model>)
sort = SortList(Keys=debrep.Faces)  # -> Keys, ValuesA
eval_2 = EvaluateLength(Curve=reparameterize(crv), Length=addition, Normalized=True)  # -> Point, Tangent, Parameter
split = SplitList(List=sort.Keys, Index=number_slider_2)  # -> ListA, ListB
panel = Panel(debrep.Faces)
panel_2 = Panel(sort.Keys)
